# Grasshopper definition 01_line_to_beam.gh (Grasshopper 1.0.8)

# ---- group: 01 · From a line to a beam
centerline = Line(Line((0, 0, 0), (3000, 0, 0)))
width = Slider(80, range=40..200)
height = Slider(160, range=40..300)
line_to_beam = LineToBeam(centerline=centerline, width=width, height=height)  # -> beam, geometry, frame, info; inputs centerline: Line
# ---------- line_to_beam: Python ----------
# r: compas_timber==2.2.0
# venv: mas-2627
"""
EXAMPLE 01 - From a line to a beam

In timber design, every beam starts as a simple LINE: its centerline.
Give that line a cross-section (width x height) and you get a BEAM.

All dimensions are in millimeters (mm), the unit timber machines use.
"""
from compas_rhino.conversions import brep_to_rhino
from compas_rhino.conversions import frame_to_rhino_plane
from compas_rhino.conversions import line_to_compas
from compas_timber.elements import Beam

# 1. Convert the Rhino line into a COMPAS line
line = line_to_compas(centerline)

# 2. Create a beam from the line and a cross-section
beam = Beam.from_centerline(line, width=width, height=height)

# 3. A beam knows a lot about itself! Let's ask it some questions
volume_in_m3 = beam.length * beam.width * beam.height / 1e9
info = f"Length: {beam.length:.0f} mm\n"
info += f"Cross-section: {beam.width:.0f} x {beam.height:.0f} mm\n"
info += f"Volume: {volume_in_m3:.3f} m3"

# 4. The frame is the beam's own coordinate system:
#    X goes along the beam, Y is the width, Z is the height
frame = frame_to_rhino_plane(beam.frame)

# 5. Convert the beam into Rhino geometry so we can see it
geometry = brep_to_rhino(beam.geometry)

# TRY THIS:
#   - Draw your own line in Rhino and right-click "centerline" > Set one Line
#   - Draw a sloped line. Which way is the beam's "height" now?
# ---------- end line_to_beam ----------
info = Panel(line_to_beam.info)
