# Grasshopper definition 02_joints.gh (Grasshopper 1.0.8)

# ---- group: L · corner
line_a = Line(Line((0, 0, 0), (1000, 0, 0)))
line_b = Line(Line((0, 0, 0), (0, 1000, 0)))
apply_joints = BooleanToggle(True)
l_joint = LJoint(line_a=line_a, line_b=line_b, apply_joints=apply_joints)  # -> model, geometry; inputs line_a: Line, line_b: Line
# ---------- l_joint: Python ----------
# r: compas_timber==2.2.0
# venv: mas-2627
"""
EXAMPLE 02a - L joint: two beams meeting at a CORNER

Two beams that touch at their END points form an "L".
"""
from compas_rhino.conversions import brep_to_rhino
from compas_rhino.conversions import line_to_compas
from compas_timber.connections import LMiterJoint
from compas_timber.elements import Beam
from compas_timber.model import TimberModel

# 1. Turn the lines into beams
beam_a = Beam.from_centerline(line_to_compas(line_a), width=80, height=120)
beam_b = Beam.from_centerline(line_to_compas(line_b), width=80, height=120)

# 2. A TimberModel is the container for all our beams and joints
model = TimberModel()
model.add_element(beam_a)
model.add_element(beam_b)

# 3. Tell the model HOW the two beams are connected
LMiterJoint.create(model, beam_a, beam_b)

# 4. Ask the model to calculate the cuts of all joints
if apply_joints:
    model.process_joinery()

# 5. Convert to Rhino geometry to see the result
geometry = [brep_to_rhino(beam.geometry) for beam in model.beams]

# TRY THIS:
#   - Right-click line_a or line_b > "Set one Line" and draw your own lines in Rhino
#     (they must touch at their END points!)
#   - Replace LMiterJoint with LButtJoint, LLapJoint or LTenonMortiseJoint
#     (remember to change the import at the top too!)
# ---------- end l_joint ----------

# ---- group: T · one beam ends on another
main_line = Line(Line((3000, 0, 0), (3000, 1000, 0)))
cross_line = Line(Line((2000, 0, 0), (4000, 0, 0)))
apply_joints_2 = BooleanToggle(True)
t_joint = TJoint(main_line=main_line, cross_line=cross_line, apply_joints=apply_joints_2)  # -> model, geometry; inputs main_line: Line, cross_line: Line
# ---------- t_joint: Python ----------
# r: compas_timber==2.2.0
# venv: mas-2627
"""
EXAMPLE 02b - T joint: one beam ENDS against the side of another

The "main" beam stops at the "cross" beam, which continues. Like the letter T.
"""
from compas_rhino.conversions import brep_to_rhino
from compas_rhino.conversions import line_to_compas
from compas_timber.connections import TButtJoint
from compas_timber.elements import Beam
from compas_timber.model import TimberModel

# 1. Turn the lines into beams
main_beam = Beam.from_centerline(line_to_compas(main_line), width=80, height=120)
cross_beam = Beam.from_centerline(line_to_compas(cross_line), width=80, height=120)

# 2. Put both beams into a model
model = TimberModel()
model.add_element(main_beam)
model.add_element(cross_beam)

# 3. Connect them. The ORDER matters: first the main beam, then the cross beam
TButtJoint.create(model, main_beam, cross_beam)

# 4. Calculate the cuts
if apply_joints:
    model.process_joinery()

# 5. Convert to Rhino geometry
geometry = [brep_to_rhino(beam.geometry) for beam in model.beams]

# TRY THIS:
#   - Draw your own lines: main_line must END on the middle of cross_line
#   - Replace TButtJoint with TLapJoint, TDovetailJoint or TTenonMortiseJoint
# ---------- end t_joint ----------

# ---- group: X · crossing
line_a_2 = Line(Line((5000, 0, 0), (7000, 0, 0)))
line_b_2 = Line(Line((6000, -1000, 0), (6000, 1000, 0)))
apply_joints_3 = BooleanToggle(True)
x_joint = XJoint(line_a=line_a_2, line_b=line_b_2, apply_joints=apply_joints_3)  # -> model, geometry; inputs line_a: Line, line_b: Line
# ---------- x_joint: Python ----------
# r: compas_timber==2.2.0
# venv: mas-2627
"""
EXAMPLE 02c - X joint: two beams CROSSING each other

Both beams continue through the joint, like the letter X.
"""
from compas_rhino.conversions import brep_to_rhino
from compas_rhino.conversions import line_to_compas
from compas_timber.connections import XLapJoint
from compas_timber.elements import Beam
from compas_timber.model import TimberModel

# 1. Turn the lines into beams
beam_a = Beam.from_centerline(line_to_compas(line_a), width=80, height=120)
beam_b = Beam.from_centerline(line_to_compas(line_b), width=80, height=120)

# 2. Put both beams into a model
model = TimberModel()
model.add_element(beam_a)
model.add_element(beam_b)

# 3. A lap joint removes half of the material from each beam, so they fit flush
XLapJoint.create(model, beam_a, beam_b)

# 4. Calculate the cuts
if apply_joints:
    model.process_joinery()

# 5. Convert to Rhino geometry
geometry = [brep_to_rhino(beam.geometry) for beam in model.beams]

# TRY THIS:
#   - Draw your own lines: they must cross each other (not touch at the ends)
#   - Replace XLapJoint with XNotchJoint
# ---------- end x_joint ----------
