# Grasshopper definition 03_design_to_fabrication.gh (Grasshopper 1.0.8)

# ---- group: STEP 1 · Design: just lines
wall_length = Slider(3000, range=1000..6000)
wall_height = Slider(2400, range=1000..3000)
stud_spacing = Slider(600, range=300..1000)
add_brace = BooleanToggle(True)
_1_design = _1Design(wall_length=wall_length, wall_height=wall_height, stud_spacing=stud_spacing, add_brace=add_brace)  # -> lines
# ---------- _1_design: Python ----------
# r: compas_timber==2.2.0
# venv: mas-2627
"""
EXAMPLE 03 - STEP 1: DESIGN

A timber stud wall is, at first, just LINES:
  - 2 horizontal "plates" (bottom and top)
  - vertical "studs" in between
  - (optional) a diagonal "brace" to make it stiff

All dimensions are in millimeters (mm).
"""
from compas.geometry import Line
from compas_rhino.conversions import line_to_rhino

lines = []

# 1. Bottom and top plates
lines.append(Line([0, 0, 0], [wall_length, 0, 0]))
lines.append(Line([0, 0, wall_height], [wall_length, 0, wall_height]))

# 2. Studs, evenly distributed along the wall
#    (we adjust the spacing a bit so the wall ends with a stud)
number_of_spaces = max(1, round(wall_length / stud_spacing))
spacing = wall_length / number_of_spaces

for i in range(number_of_spaces + 1):
    x = i * spacing
    lines.append(Line([x, 0, 0], [x, 0, wall_height]))

# 3. A diagonal brace, from the bottom plate to the top plate
if add_brace:
    lines.append(Line([spacing / 2, 0, 0], [wall_length - spacing / 2, 0, wall_height]))

# 4. Convert to Rhino lines so we can see them
lines = [line_to_rhino(line) for line in lines]
# ---------- end _1_design ----------

# ---- group: STEP 2 · Timber model: beams + joints
width = Slider(60, range=40..200)
height = Slider(120, range=40..300)
_2_timber_model = _2TimberModel(lines=_1_design, width=width, height=height)  # -> model, geometry, info; inputs lines: list of Line
# ---------- _2_timber_model: Python ----------
# r: compas_timber==2.2.0
# venv: mas-2627
"""
EXAMPLE 03 - STEP 2: TIMBER MODEL

Turn every line into a beam. Then let the computer find WHERE beams
meet and HOW (L, T or X), and pick a joint for each case.
"""
import itertools

from compas.geometry import Vector
from compas.tolerance import Tolerance
from compas_rhino.conversions import brep_to_rhino
from compas_rhino.conversions import line_to_compas
from compas_timber.connections import ConnectionSolver
from compas_timber.connections import JointTopology
from compas_timber.connections import LButtJoint
from compas_timber.connections import TButtJoint
from compas_timber.connections import XLapJoint
from compas_timber.elements import Beam
from compas_timber.model import TimberModel

# 1. An empty model. We tell it we work in millimeters
model = TimberModel(tolerance=Tolerance(unit="MM"))

# 2. One beam per line
for line in lines:
    line = line_to_compas(line)

    # The beam's height points into the wall (Y axis),
    # so all beams have the same thickness
    beam = Beam.from_centerline(line, width=width, height=height, z_vector=Vector(0, 1, 0))

    # Give each beam a name based on its direction
    if abs(line.direction.z) < 0.01:
        beam.name = "plate"
    elif abs(line.direction.x) < 0.01:
        beam.name = "stud"
    else:
        beam.name = "brace"

    model.add_element(beam)

# 3. Check every PAIR of beams: do they touch? And how?
solver = ConnectionSolver()
joint_count = {"L": 0, "T": 0, "X": 0}

for beam_a, beam_b in itertools.combinations(model.beams, 2):
    result = solver.find_topology(beam_a, beam_b, max_distance=1)

    # 4. Choose a joint for each type of meeting
    if result.topology == JointTopology.TOPO_L:
        # corner: we want the stud to be cut, and the plate to run through
        if result.beam_a.name == "plate":
            LButtJoint.create(model, result.beam_b, result.beam_a)
        else:
            LButtJoint.create(model, result.beam_a, result.beam_b)
        joint_count["L"] += 1

    elif result.topology == JointTopology.TOPO_T:
        # the solver already gives us the main beam first
        TButtJoint.create(model, result.beam_a, result.beam_b)
        joint_count["T"] += 1

    elif result.topology == JointTopology.TOPO_X:
        XLapJoint.create(model, result.beam_a, result.beam_b)
        joint_count["X"] += 1

# 5. Calculate all the cuts
errors = model.process_joinery()

# 6. Outputs
geometry = [brep_to_rhino(beam.geometry) for beam in model.beams]
info = f"{len(model.beams)} beams\n"
info += f"{joint_count['L']} L joints, {joint_count['T']} T joints, {joint_count['X']} X joints\n"
info += f"{len(errors)} errors"
# ---------- end _2_timber_model ----------

# ---- group: STEP 3 · Fabrication: cutting list + BTLx
export_btlx = BooleanToggle(False)
btlx_file = FilePath()
_3_fabrication = _3Fabrication(model=_2_timber_model.model, export_btlx=export_btlx, btlx_file=btlx_file)  # -> cutting_list, layout; inputs btlx_file: String
# ---------- _3_fabrication: Python ----------
# r: compas_timber==2.2.0
# venv: mas-2627
"""
EXAMPLE 03 - STEP 3: FABRICATION

The model knows every beam and every cut, so we can produce:
  1. a CUTTING LIST (what to order and cut)
  2. a LAYOUT with all parts lying flat, as on the machine table
  3. a BTLx file: the standard file that timber CNC machines read
"""
from compas.geometry import Frame
from compas.geometry import Transformation
from compas_rhino.conversions import brep_to_rhino
from compas_timber.fabrication import BTLxWriter

cutting_list = []
layout = []
total_length = 0
y = -1000  # the "machine table" is in front of the wall

for number, beam in enumerate(model.beams, start=1):

    # 1. One line of the cutting list per beam
    #    (the blank is the raw piece of timber, before cutting the joints)
    cutting_list.append(
        f"#{number:02d}  {beam.name:<6} {beam.blank_length:6.0f} mm   "
        f"{beam.width:.0f} x {beam.height:.0f} mm   {len(beam.features)} cuts"
    )
    total_length += beam.blank_length

    # 2. Move the beam from the wall to its spot on the table
    #    (lifted by half its height, so it lies ON the table, not half inside it)
    spot_on_table = Frame([0, y, beam.height / 2], [1, 0, 0], [0, 1, 0])
    move = Transformation.from_frame_to_frame(beam.frame, spot_on_table)
    layout.append(brep_to_rhino(beam.geometry.transformed(move)))
    y -= beam.width + 100

cutting_list.append(f"TOTAL: {total_length / 1000:.2f} m of timber")

# 3. Write the BTLx file to the path that comes from the "Get File Path" input
if export_btlx and btlx_file:
    BTLxWriter().write(model, btlx_file)
# ---------- end _3_fabrication ----------

# ----
info = Panel(_2_timber_model.info)
cutting_list = Panel(_3_fabrication.cutting_list)
