# Grasshopper definition 04_print_clearance.gh (Grasshopper 1.0.8)

# ---- group: 3D print · add clearance to the joints
clearance = Slider(0.15, range=0..0.5)
scale = Slider(0.1, range=0.05..1)
print_parts = PrintParts(clearance=clearance, scale=scale)  # -> assembled, layout; inputs models: list
# ---------- print_parts: Python ----------
# r: compas_timber==2.2.0
# venv: mas-2627
"""
EXAMPLE 02e - 3D printing the parts: add a little clearance to the joints

Joints in the model have ZERO tolerance: the hole is exactly the size of what
goes into it. That is what you want for the CNC (wood is a bit soft), but
plastic (PLA) is hard and prints slightly too fat, so a tight joint won't fit.

The rule used here: the HOLES grow, the pegs stay the same.
  - Laps:     the side walls move outwards by `clearance`.
              The bottom does NOT move: the two beams rest on it, so they stay flush.
  - Mortises: all walls and the bottom move outwards by `clearance`.
  - Tenons and all other cuts stay exactly as designed.
So every face that has to SLIDE gets a gap of `clearance`, and every face that
has to CARRY (lap bottom, tenon shoulder) still touches.

The model itself is not changed (the BTLx for the CNC stays exact):
the clearance is only added to the geometry we send to the printer.

    models:    one or more timber models
    clearance: gap in PRINTED millimeters (0.1 - 0.2 mm works for most PLA printers)
    scale:     print scale, e.g. 0.1 for 1:10
    assembled: the parts in their place in the model (scaled), to check the fit
    layout:    the parts lying flat on the XY plane, ready to export to the slicer
"""
import copy

from compas.geometry import Box
from compas.geometry import Brep
from compas.geometry import Plane
from compas.geometry import Point
from compas.geometry import Rotation
from compas.geometry import Scale
from compas.geometry import Vector
from compas.geometry import angle_vectors_signed
from compas.geometry import centroid_points
from compas_rhino.conversions import brep_to_rhino
from compas_timber.fabrication import Lap
from compas_timber.fabrication import Mortise
from Grasshopper.Kernel import GH_RuntimeMessageLevel as RML

clearance = clearance if clearance is not None else 0.15
scale = scale or 1.0
gap_between_parts = 5.0  # printed mm


def move_away(plane, point, distance):
    """Move a plane by `distance`, away from `point`."""
    if plane.normal.dot(Vector.from_start_end(plane.point, point)) > 0:
        distance = -distance
    return Plane(plane.point + plane.normal * distance, plane.normal)


def unproxified(feature):
    return feature.unproxified() if hasattr(feature, "unproxified") else feature


def with_clearance(feature, c):
    """Return a copy of the feature whose hole is `c` bigger. Other features are returned as they are."""
    feature = unproxified(feature)

    if isinstance(feature, Lap):
        # a lap is built from 6 planes: start, end, top, bottom, front, back
        def planes_with_clearance(beam):
            planes = feature._planes_from_params_and_beam(beam)
            center = Point(*centroid_points(feature.volume_from_params_and_beam(beam).vertices))
            # every plane moves outwards, except the bottom (index 3), where the beams rest on each other
            return [plane if i == 3 else move_away(plane, center, c) for i, plane in enumerate(planes)]

        bigger = copy.copy(feature)
        bigger._planes_from_params_and_beam = planes_with_clearance
        return bigger

    if isinstance(feature, Mortise):
        # a mortise is a box: make it bigger in every direction
        def volume_with_clearance(beam):
            frame = feature.frame_from_params_and_beam(beam)
            frame.translate((-frame.normal * feature.depth - frame.yaxis * feature.length) * 0.5)
            box = Box(feature.width + 2 * c, feature.length + 2 * c, feature.depth + 2 * c, frame)
            return Brep.from_box(box)

        bigger = copy.copy(feature)
        bigger.volume_from_params_and_beam = volume_with_clearance
        return bigger

    return feature


def printable_geometry(beam, c):
    """Same as beam.geometry, but with clearance in the holes. Returned in the beam's LOCAL coordinates."""
    geometry = Brep.from_box(beam.blank.transformed(beam.transformation_to_local()))
    for feature in beam.features:
        try:
            geometry = with_clearance(feature, c).apply(geometry, beam)
        except Exception as error:
            ghenv.Component.AddRuntimeMessage(RML.Warning, "{}: {}".format(type(feature).__name__, error))
    return geometry


def lay_flat(beam, geometry):
    """Turn the part around its axis so the first hole faces up (prints without supports)."""
    holes = [f for f in map(unproxified, beam.features) if isinstance(f, (Lap, Mortise))]
    if not holes:
        return geometry
    up = beam.ref_sides[holes[0].ref_side_index].transformed(beam.transformation_to_local()).normal
    angle = angle_vectors_signed(up, Vector.Zaxis(), Vector.Xaxis())
    return geometry.transformed(Rotation.from_axis_and_angle(Vector.Xaxis(), angle))


clearance_in_model = clearance / scale  # the clearance is in printed mm, the model is in real mm
to_print_scale = Scale.from_factors([scale] * 3)

assembled = []
layout = []
y = 0.0
for model in models:
    for beam in model.beams:
        local = printable_geometry(beam, clearance_in_model)

        # in place, to check that everything still fits together
        assembled.append(brep_to_rhino(local.transformed(to_print_scale * beam.modeltransformation)))

        # flat on the build plate, one next to the other
        part = brep_to_rhino(lay_flat(beam, local).transformed(to_print_scale))
        box = part.GetBoundingBox(True)
        part.Translate(-box.Min.X, y - box.Min.Y, -box.Min.Z)
        layout.append(part)
        y += box.Diagonal.Y + gap_between_parts

# TRY THIS:
#   - Print a small test first: the X joint at scale 0.1 with clearance 0.1, 0.15 and 0.2
#     and keep the value that slides in by hand without wobbling
#   - Set clearance to 0 and look at "assembled": it is exactly the model again
# ---------- end print_parts ----------
