# Grasshopper definition pergola.gh (Grasshopper 1.0.8)

# ---- group: STEP 1 · Design: just lines
length = Slider(3000, range=1500..5000)
depth = Slider(2500, range=1000..4000)
height = Slider(2400, range=2000..3000)
overhang = Slider(300, range=100..600)
rafter_count = Slider(6, range=2..15)
_1_pergola_design = _1PergolaDesign(length=length, depth=depth, height=height, overhang=overhang, rafter_count=rafter_count)  # -> lines; inputs rafter_count: Int32
# ---------- _1_pergola_design: Python ----------
# r: compas_timber==2.2.0
# venv: mas-2627
"""
EXERCISE - TIMBER PERGOLA - STEP 1: DESIGN

A pergola is made of:
  - 4 vertical POSTS at the corners
  - 2 horizontal BEAMS on top of the posts (along X)
  - several RAFTERS crossing the beams (along Y)

All dimensions are in millimeters (mm).
"""
# 0. Import everything we will need
from compas.geometry import Line
from compas_rhino.conversions import line_to_rhino

# 1. Start with an empty list of lines
#    make sure to match the name of this list to the output of this component!
# ... your code here ...

# 2. Four POSTS: vertical lines from the ground (z = 0) up to the height
#    Hint: two nested for loops, one for x in [0, length], one for y in [0, depth]
# ... your code here ...

# 3. Two BEAMS on top of the posts (z = height), running along X
#    One at y = 0 and one at y = depth.
#    They stick out on both sides: from x = -overhang to x = length + overhang
# ... your code here ...

# 4. RAFTERS crossing the beams (z = height), running along Y
#    Spread them evenly along the length:
#      spacing = length / rafter_count
#      rafter number i is at x = (i + 0.5) * spacing
#    They also stick out: from y = -overhang to y = depth + overhang
# ... your code here ...

# 5. Convert all lines to Rhino lines (line_to_rhino) so we can see them
# ... your code here ...
# ---------- end _1_pergola_design ----------

# ---- group: STEP 2 · Timber model: beams + joints
beam_width = Slider(100, range=60..200)
beam_height = Slider(160, range=60..300)
_2_pergola_timber_model = _2PergolaTimberModel(lines=_1_pergola_design, beam_width=beam_width, beam_height=beam_height)  # -> model, geometry, info; inputs lines: list of Line
# ---------- _2_pergola_timber_model: Python ----------
# r: compas_timber==2.2.0
# venv: mas-2627
"""
EXERCISE - TIMBER PERGOLA - STEP 2: TIMBER MODEL

Turn the lines into beams and connect them:
  - posts END against the beams     -> T topology -> tenon & mortise joint
  - rafters CROSS the beams         -> X topology -> lap joint

Hint: example 03_design_to_fabrication.gh does something very similar!
"""
# 0. Import everything we will need
import itertools

from compas.tolerance import Tolerance
from compas_rhino.conversions import brep_to_rhino
from compas_rhino.conversions import line_to_compas
from compas_timber.connections import ConnectionSolver
from compas_timber.connections import JointTopology
from compas_timber.connections import TTenonMortiseJoint
from compas_timber.connections import XLapJoint
from compas_timber.elements import Beam
from compas_timber.model import TimberModel

# 1. Create an empty timber model that works in millimeters
#    Hint: TimberModel(tolerance=Tolerance(unit="MM"))
# ... your code here ...

# 2. For each line:
#      - convert it to a COMPAS line with line_to_compas
#      - create a beam with Beam.from_centerline, using beam_width and beam_height
#      - give it a name (beam.name): "post", "beam" or "rafter", based on its direction
#        Hint: for a vertical line, abs(line.direction.z) is 1
#      - add it to the model
# ... your code here ...

# 3. Check every PAIR of beams with a ConnectionSolver and create the joints:
#      - JointTopology.TOPO_T -> TTenonMortiseJoint
#      - JointTopology.TOPO_X -> XLapJoint
#    Hint: itertools.combinations(model.beams, 2) gives you all the pairs
# ... your code here ...

# 4. Calculate all the cuts
# ... your code here ...

# 5. Outputs:
#      - geometry: a list with the Rhino geometry of every beam (brep_to_rhino(beam.geometry))
#      - info: a text with the number of beams
#    Bonus: count how many joints of each type you created and add it to info
# ... your code here ...
# ---------- end _2_pergola_timber_model ----------

# ---- group: STEP 3 · Fabrication (given)
export_btlx = BooleanToggle(False)
btlx_file = FilePath()
_3_fabrication = _3Fabrication(model=_2_pergola_timber_model.model, export_btlx=export_btlx, btlx_file=btlx_file)  # -> cutting_list, layout; inputs btlx_file: String
# ---------- _3_fabrication: Python ----------
# r: compas_timber==2.2.0
# venv: mas-2627
"""
EXERCISE - TIMBER PERGOLA - STEP 3: FABRICATION (already done for you!)

Same as in example 03:
  1. a CUTTING LIST
  2. a LAYOUT with all parts lying flat, as on the machine table
  3. a BTLx file for the timber CNC machine
"""
from compas.geometry import Frame
from compas.geometry import Transformation
from compas_rhino.conversions import brep_to_rhino
from compas_timber.fabrication import BTLxWriter

cutting_list = []
layout = []
total_length = 0
y = -1000  # the "machine table" is in front of the pergola

for number, beam in enumerate(model.beams, start=1):

    # 1. One line of the cutting list per beam
    cutting_list.append(
        f"#{number:02d}  {beam.name:<6} {beam.blank_length:6.0f} mm   "
        f"{beam.width:.0f} x {beam.height:.0f} mm   {len(beam.features)} cuts"
    )
    total_length += beam.blank_length

    # 2. Move the beam to its spot on the table
    #    (lifted by half its height, so it lies ON the table, not half inside it)
    spot_on_table = Frame([0, y, beam.height / 2], [1, 0, 0], [0, 1, 0])
    move = Transformation.from_frame_to_frame(beam.frame, spot_on_table)
    layout.append(brep_to_rhino(beam.geometry.transformed(move)))
    y -= beam.width + 100

cutting_list.append(f"TOTAL: {total_length / 1000:.2f} m of timber")

# 3. Write the BTLx file to the path that comes from the "Get File Path" input
if export_btlx and btlx_file:
    BTLxWriter().write(model, btlx_file)
# ---------- end _3_fabrication ----------

# ----
info = Panel(_2_pergola_timber_model.info)
cutting_list = Panel(_3_fabrication.cutting_list)

# ---- group: STEP 4 · 3D print a scale model (given)
scale = Slider(20, range=5..50)
export_stl = BooleanToggle(False)
_4_3d_print = _43DPrint(layout=_3_fabrication.layout, scale=scale, export_stl=export_stl)  # -> info, stl_file; inputs layout: list of Brep, scale: Int32
# ---------- _4_3d_print: Python ----------
# r: compas_timber==2.2.0
# venv: mas-2627
"""
EXERCISE - TIMBER PERGOLA - STEP 4: 3D PRINT A SCALE MODEL (already done for you!)

3D printers read STL files: a list of TRIANGLES describing the surface of an object.
We take the beams lying flat on the table, turn them into triangles,
scale them down, and save everything in one STL file.
"""
import os

import Rhino.Geometry as rg
from compas_rhino.conversions import mesh_to_compas

# 1. Turn every beam (a Brep) into a mesh of triangles, all in one mesh
print_mesh = rg.Mesh()
for brep in layout:
    for piece in rg.Mesh.CreateFromBrep(brep, rg.MeshingParameters.QualityRenderMesh):
        print_mesh.Append(piece)
print_mesh.Faces.ConvertQuadsToTriangles()

# 2. Scale it down. The pergola is in mm and printers also work in mm,
#    so at 1:1 a beam would be 3 meters long! A scale of 20 means 1:20
print_mesh.Scale(1 / scale)

# 3. How big is the print? Check that it fits on your printer's bed
box = print_mesh.GetBoundingBox(True)
size = box.Max - box.Min
info = f"Scale 1:{scale}\n"
info += f"Print size: {size.X:.0f} x {size.Y:.0f} x {size.Z:.0f} mm\n"
info += f"{print_mesh.Faces.Count} triangles"
if print_mesh.Faces.Count == 0:
    info = "Nothing to print yet: finish the previous steps first!"

# 4. Write the STL file next to this Grasshopper file
stl_file = None
if export_stl:
    gh_file = ghenv.Component.OnPingDocument().FilePath
    folder = os.path.dirname(gh_file) if gh_file else os.path.expanduser("~")
    stl_file = os.path.join(folder, "pergola.stl")
    mesh_to_compas(print_mesh).to_stl(stl_file, binary=True)
# ---------- end _4_3d_print ----------
print_info = Panel(_4_3d_print.info)
